# Grasshopper definition ICEbear4Grasshopper_Example.gh (Grasshopper 1.0.8)

# ---- group: Simple Geometry example
surf_internalwalls = Brep([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])
surf_externalwall = Brep(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)
surf_daylightgrid = Brep(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)
surf_ceiling = Brep(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)
surf_windows = Brep(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)
surf_floor = Brep(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)

# ---- group: Connect Geometry and press button
icebear_gui_ver_2_2_0_0 = ICEbearGUIVersion2200(
    OpenICEbearGUI=Button(),
    Ceiling=surf_ceiling,
    ExtWalls=surf_externalwall,
    IntWalls=surf_internalwalls,
    Floor=surf_floor,
    AllWindows=surf_windows,
    DaylightGrids=surf_daylightgrid)  # inputs OpenICEbearGUI: Boolean, ExtObstructions: list of Brep, Roof: list of Brep, Ceiling: list of Brep, ExtWalls: list of Brep, IntWalls: list of Brep, Floor: list of Brep, FloorOnGround: list of Brep, AllWindows: list of Brep, VentInlets: list of Brep, VentOutlets: list of Brep, DaylightGrids: list of Brep, BuildHeight: Double
# ---------- icebear_gui_ver_2_2_0_0: C# ----------
// Grasshopper Script Instance
#region Usings
using System;
using System.Linq;
using System.Collections;
using System.Collections.Generic;
using System.Drawing;
using Rhino;
using Rhino.Geometry;
using Grasshopper;
using Grasshopper.Kernel;
using Grasshopper.Kernel.Data;
using Grasshopper.Kernel.Types;
using System.IO;
using System.Data;
using System.Reflection;
using System.Windows.Forms;
using System.Xml;
using System.Xml.Linq;
using System.Runtime.InteropServices;
using Rhino.DocObjects;
using Rhino.Collections;
#endregion

public class Script_Instance : GH_ScriptInstance
{
    #region Notes
    /* 
      Members:
        RhinoDoc RhinoDocument
        GH_Document GrasshopperDocument
        IGH_Component Component
        int Iteration

      Methods (Virtual & overridable):
        Print(string text)
        Print(string format, params object[] args)
        Reflect(object obj)
        Reflect(object obj, string method_name)
    */
    #endregion

    private void RunScript(
		bool OpenICEbearGUI,
		List<Brep> ExtObstructions,
		List<Brep> Roof,
		List<Brep> Ceiling,
		List<Brep> ExtWalls,
		List<Brep> IntWalls,
		List<Brep> Floor,
		List<Brep> FloorOnGround,
		List<Brep> AllWindows,
		List<Brep> VentInlets,
		List<Brep> VentOutlets,
		List<Brep> DaylightGrids,
		double BuildHeight)
    {
        //ICEbear GUI version 2.2.0.0
        //This code assess Rhino geometry, convert it into an xml-format accessible for ICEbear and open ICEbear GUI for simulation. 
        //Code Written by Pil Brix Purup and Thea Broholt

    //--------------Input------------------------
        List<Brep> ExternalWall = ExtWalls;
    //List<Brep> Floor = Floor;
    //List<Brep> Roof = Roof;
    List<Brep> FloorFacingGround = FloorOnGround;
    List<Brep> InletOpenings = VentInlets;
    List<Brep> OutletOpenings = VentOutlets;
    List<Brep> Windows = AllWindows;
    List<Brep> ExternalGeometry = ExtObstructions;
    List<Brep> OpenableWindows = new List<Brep>();
    Double BuildingHeight = BuildHeight;



    //---------------WRITE TO XML-FILE-----------------
    //Xml settings:
    XmlWriterSettings settings = new XmlWriterSettings();
    settings.Indent = true;
    settings.IndentChars = ("  ");
    settings.OmitXmlDeclaration = true;


    //Create xml-file, with filepath:    
    string appData = System.Environment.GetFolderPath(System.Environment.SpecialFolder.ApplicationData);
    string filePath = System.IO.Path.Combine(appData, "ICEbear", "BuildingGeometry.xml");
    XmlWriter xmlDoc = XmlWriter.Create(filePath, settings);
    xmlDoc.WriteStartDocument();        //Start writing to document
    xmlDoc.WriteStartElement("Room");   //Header Room - start



    //----ROOM----
    xmlDoc.WriteStartElement("room");       //Header room - start
    xmlDoc.WriteStartElement("name");     //Element name - start
    xmlDoc.WriteString("buildingGeometry"); //Value of name
    xmlDoc.WriteEndElement();             //Element name - end
    xmlDoc.WriteEndElement();               //Header room - end

    //----BUILDING----
    xmlDoc.WriteStartElement("buildingheight");       //Header building - start
    double height = 5; //Default value
    if (BuildingHeight > 0){height = Math.Round(BuildingHeight, 3);}
    xmlDoc.WriteValue(height);            //Value of buildingheight
    xmlDoc.WriteEndElement();               //Element buildingheight - end


    //----ROOF----
    xmlDoc.WriteStartElement("roof");       //Header roof - start

    double totalRoofArea = 0;
    if (Roof != null)
    {
      List<double> roofAreaList = new List<double>(); //Possible to have more than one roof surface

      int count = 0;
      foreach (Brep roof in Roof)   //Loop through list of roof surfaces
      {
        //Curve[] Edges = roof.DuplicateNakedEdgeCurves(true, false);
        //Brep[] BoundingBrep = Brep.CreatePlanarBreps(Edges, 0.001);
        //double roofArea = BoundingBrep[0].GetArea();    //Get area of each roof surface
        double roofArea = roof.GetArea();    //Get area of each roof surface
        roofAreaList.Add(roofArea);                 //Create list of all roof surface areas

        count++;                                    //Use counter to get area of current roof surface in loop
      }
      totalRoofArea = Math.Round(roofAreaList.Sum(), 6);         //Sum the area of all roof surfaces
    }




    xmlDoc.WriteStartElement("area");       //Element area - start
    xmlDoc.WriteValue(totalRoofArea);            //Value of area
    xmlDoc.WriteEndElement();               //Element area - end

    xmlDoc.WriteEndElement();               //Header roof - end

    //----EXTERNAL WALL----
    xmlDoc.WriteStartElement("wall");       //Header wall - start
    double totalExternalWallArea = 0;
    if (ExternalWall != null)   //Evaluating if an external wall is given from model
    {
      List<double> externalWallAreaList = new List<double>(); //Possible to have more than one external wall

      int count = 0;
      foreach (Brep wall in ExternalWall)   //Loop through list of external walls
      {
        double externalWallArea = wall.GetArea();    //Get area of each external wall
        externalWallAreaList.Add(externalWallArea);                 //Create list of all external wall areas

        count++;      //Use counter to get area of current wall surface in loop
      }

      totalExternalWallArea = externalWallAreaList.Sum();    //Sum the area of all external areas
    }
    xmlDoc.WriteStartElement("area");       //Element area - start
    xmlDoc.WriteValue(Math.Round(totalExternalWallArea, 6));  //Value of area
    xmlDoc.WriteEndElement();               //Element area - end
    xmlDoc.WriteEndElement();               //Header wall - end


    //----CURTAIN WALLS----
    xmlDoc.WriteStartElement("curtainWalls"); //Header curtainWall - start
    xmlDoc.WriteEndElement();                 //Header curtainWall - end


    //----FLOOR----
    xmlDoc.WriteStartElement("floor");      //Header floor - start
    double totalFloorArea = 0;
    if (Floor != null)
    {
      List<double> floorAreaList = new List<double>(); //Possible to have more than one floor surface

      int count = 0;
      foreach (Brep floor in Floor)   //Loop through list of floor surfaces
      {
        double floorArea = Floor[count].GetArea();    //Get area of each floor surface
        floorAreaList.Add(floorArea);                 //Create list of all floor surface areas

        count++;      //Use counter to get area of current floor surface in loop
      }

      totalFloorArea = floorAreaList.Sum();    //Sum the area of all floor surfaces
    }
    xmlDoc.WriteStartElement("area");       //Element area - start
    xmlDoc.WriteValue(Math.Round(totalFloorArea, 6));  //Value of area
    xmlDoc.WriteEndElement();               //Element area - end
    xmlDoc.WriteEndElement();               //Header floor - end


    //----GROUND----
    xmlDoc.WriteStartElement("ground");      //Header ground - start
    double totalGroundArea = 0;
    if (FloorFacingGround != null)
    {
      List<double> groundAreaList = new List<double>(); //Possible to have more than one ground surface

      int count = 0;
      foreach (Brep gnd in FloorFacingGround)   //Loop through list of ground surfaces
      {
        double groundArea = FloorFacingGround[count].GetArea();    //Get area of each ground surface
        groundAreaList.Add(groundArea);                 //Create list of all ground surface areas

        count++;        //Use counter to get area of current ground surface in loop
      }

      totalGroundArea = groundAreaList.Sum();    //Sum the area of all floor surfaces
    }
    xmlDoc.WriteStartElement("area");       //Element area - start
    xmlDoc.WriteValue(Math.Round(totalGroundArea, 6));  //Value of area
    xmlDoc.WriteEndElement();               //Element area - end
    xmlDoc.WriteEndElement();               //Header ground - end


    Vector3d windowNormal = new Vector3d();
    Point3d windowCenter = new Point3d();

    //----All glazing WINDOWS----
    xmlDoc.WriteStartElement("windows");    //Header windows - start
    double windowArea = 0;
    if (Windows != null)  //Evaluating if a window is given from model
    {
      int count = 0;
      foreach (Brep wind in Windows) //Possible to have more than one window
      {
        xmlDoc.WriteStartElement("window");   //Header window - start

        windowArea = Windows[count].GetArea(); //Determine area of window

        xmlDoc.WriteStartElement("area");       //Element area - start
        xmlDoc.WriteValue(Math.Round(windowArea, 6));            //Value area
        xmlDoc.WriteEndElement();               //Element area - end

        //Determine window perimeter
        Curve[] windowCurve = Curve.JoinCurves(Windows[count].GetWireframe(-1));  //Create curve around window
        double windowPerimeter = windowCurve[0].GetLength();   //Get length of curve

        xmlDoc.WriteStartElement("perimeter");  //Element perimeter - start
        xmlDoc.WriteValue(Math.Round(windowPerimeter, 3));       //Value perimeter
        xmlDoc.WriteEndElement();               //Element perimeter - end

        //Determine window corners
        Point3d[] windowCorners = Windows[count].DuplicateVertices().ToArray();

        //Determine window centers
        windowCenter = VolumeMassProperties.Compute(wind).Centroid;

        xmlDoc.WriteStartElement("cornerCoordinates");  //Element cornerCoordinates - start

        foreach (Point3d c in windowCorners)  //More than one corner
        {
          xmlDoc.WriteStartElement("corners");  //Element corners - start
          xmlDoc.WriteStartElement("x");          //Element x - start
          xmlDoc.WriteValue(Math.Round(c.X, 3));                   //Value x
          xmlDoc.WriteEndElement();               //Element x - end
          xmlDoc.WriteStartElement("y");          //Element y - start
          xmlDoc.WriteValue(Math.Round(c.Y, 3));                   //Value y
          xmlDoc.WriteEndElement();               //Element y - end
          xmlDoc.WriteStartElement("z");          //Element z - start
          xmlDoc.WriteValue(Math.Round(c.Z, 3));                   //Value z
          xmlDoc.WriteEndElement();               //Element z - end
          xmlDoc.WriteEndElement();             //Element corners - end
        }

        xmlDoc.WriteEndElement();           //Element cornerCoordinates - end

        //Determine window orientation
        //Get window normal
        Vector3d CrossP = Vector3d.CrossProduct((windowCorners[1] - windowCorners[0]), (windowCorners[2] - windowCorners[0]));
        double vectorLength = CrossP.Length;
        windowNormal = CrossP / vectorLength;    //Normalized normal vector of window surface

        //if window horizontal:
        if (windowNormal.X == 0 & windowNormal.Y == 0)
        {
          double windowOrientation = 0;
          double windowTilt = 0;

          //check if skylight in floor
          Point3d[] FloorCorners;
          if (Floor != null) {FloorCorners = Floor[0].DuplicateVertices().ToArray();}
          else{FloorCorners = FloorFacingGround[0].DuplicateVertices().ToArray();}
          if(windowCorners[0].Z <= FloorCorners[0].Z) //Skylight in floor
          {
            windowTilt = 180;
          }

          xmlDoc.WriteStartElement("orientation");    //Element orientation - start
          xmlDoc.WriteValue(Math.Round(windowOrientation, 3));           //Value orientation
          xmlDoc.WriteEndElement();                   //Element orientation - end

          xmlDoc.WriteStartElement("tilt");         //Element tilt - start
          xmlDoc.WriteValue(Math.Round(windowTilt, 3));              //Value tilt
          xmlDoc.WriteEndElement();                 //Element tilt - end
        }
        else // window not horizontal
        {
          //Get window normal to face outside
          double angleSum = new double();   //value used for test

          if (Floor != null)
          {
            int count_F = 0;

            foreach (Brep floor in Floor)     //Loop through floor surfaces
            {
              //Move window corner point with window normal-vector (into or out of the room)
              Point3d[] floorCorners = Floor[count_F].DuplicateVertices().ToArray();    //Getting cornerpoints of floor
              Point3d floorCorner = floorCorners[0];  //Single corner in floor surface
              Point3d windowCorner = windowCorners[0];  //Single corner in window surface
              Point3d windowMove = new Point3d((windowCorner.X + windowNormal.X), (windowCorner.Y + windowNormal.Y), (windowCorner.Z + windowNormal.Z));  //move windowCorner

              //Move window corner to floor height
              Point3d windowToFloor = new Point3d(windowMove.X, windowMove.Y, floorCorner.Z);

              double ang_last = new double();
              double Angle_sum1 = new double();

              //Evaluate if moved point is within the floor surface
              for (int s = 1; s < floorCorners.Length; s++)
              {
                Vector3d v_intPntToPnt1 = new Vector3d(floorCorners[s - 1].X - windowToFloor.X, floorCorners[s - 1].Y - windowToFloor.Y, floorCorners[s - 1].Z - windowToFloor.Z);
                Vector3d v_intPntToPnt2 = new Vector3d(floorCorners[s].X - windowToFloor.X, floorCorners[s].Y - windowToFloor.Y, floorCorners[s].Z - windowToFloor.Z);

                Vector3d v_first = new Vector3d(floorCorners[0].X - windowToFloor.X, floorCorners[0].Y - windowToFloor.Y, floorCorners[0].Z - windowToFloor.Z);
                Vector3d v_last = new Vector3d(floorCorners[floorCorners.Length - 1].X - windowToFloor.X, floorCorners[floorCorners.Length - 1].Y - windowToFloor.Y, floorCorners[floorCorners.Length - 1].Z - windowToFloor.Z);

                ang_last = Vector3d.VectorAngle(v_first, v_last) * 180 / Math.PI;

                Angle_sum1 += Vector3d.VectorAngle(v_intPntToPnt1, v_intPntToPnt2) * 180 / Math.PI;
              }

              angleSum = Math.Round(ang_last + Angle_sum1, 2);

              if (angleSum == 360)
              {
                windowNormal = -windowNormal;

                break;
              }
            }
          }

          if (FloorFacingGround != null && angleSum != 360)
          {
            int count_F = 0;

            foreach (Brep floor in FloorFacingGround)     //Loop through floor surfaces
            {
              //Move window corner point with window normal-vector (into or out of the room)
              Point3d[] floorCorners = FloorFacingGround[count_F].DuplicateVertices().ToArray();    //Getting cornerpoints of floor
              Point3d floorCorner = floorCorners[0];  //Single corner in floor surface
              Point3d windowCorner = windowCorners[0];  //Single corner in window surface
              Point3d windowMove = new Point3d((windowCorner.X + windowNormal.X), (windowCorner.Y + windowNormal.Y), (windowCorner.Z + windowNormal.Z));  //move windowCorner

              //Move window corner to floor height
              Point3d windowToFloor = new Point3d(windowMove.X, windowMove.Y, floorCorner.Z);

              double ang_last = new double();
              double Angle_sum1 = new double();

              //Evaluate if moved point is within the floor surface
              for (int s = 1; s < floorCorners.Length; s++)
              {
                Vector3d v_intPntToPnt1 = new Vector3d(floorCorners[s - 1].X - windowToFloor.X, floorCorners[s - 1].Y - windowToFloor.Y, floorCorners[s - 1].Z - windowToFloor.Z);
                Vector3d v_intPntToPnt2 = new Vector3d(floorCorners[s].X - windowToFloor.X, floorCorners[s].Y - windowToFloor.Y, floorCorners[s].Z - windowToFloor.Z);

                Vector3d v_first = new Vector3d(floorCorners[0].X - windowToFloor.X, floorCorners[0].Y - windowToFloor.Y, floorCorners[0].Z - windowToFloor.Z);
                Vector3d v_last = new Vector3d(floorCorners[floorCorners.Length - 1].X - windowToFloor.X, floorCorners[floorCorners.Length - 1].Y - windowToFloor.Y, floorCorners[floorCorners.Length - 1].Z - windowToFloor.Z);

                ang_last = Vector3d.VectorAngle(v_first, v_last) * 180 / Math.PI;

                Angle_sum1 += Vector3d.VectorAngle(v_intPntToPnt1, v_intPntToPnt2) * 180 / Math.PI;
              }

              angleSum = Math.Round(ang_last + Angle_sum1, 2);

              if (angleSum == 360)
              {
                windowNormal = new Vector3d (-windowNormal.X, -windowNormal.Y, -windowNormal.Z);

                break;
              }
            }
          }

          Vector3d yAxis = new Vector3d(0, 1, 0);   //y-axis negative
          Vector3d windowNormalXY = new Vector3d(windowNormal.X, windowNormal.Y, 0);  //Window normal in x-y-direction

          double windowOrientation = new double();

          if (windowNormalXY.X <= 0)   //If normal x-coordinate is negative (west)
          {
            windowOrientation = -Vector3d.VectorAngle(yAxis, windowNormalXY) * 180 / Math.PI; //Window orientation [deg]
          }
          else                        //normal x-coordinate is positive (east)
          {
            windowOrientation = Vector3d.VectorAngle(yAxis, windowNormalXY) * 180 / Math.PI;
          }

          xmlDoc.WriteStartElement("orientation");    //Element orientation - start
          xmlDoc.WriteValue(Math.Round(windowOrientation, 3));           //Value orientation
          xmlDoc.WriteEndElement();                   //Element orientation - end

          //Determine window tilt
          Vector3d zAxis = new Vector3d(0, 0, 1);   //z-axis
          double windowTilt = Vector3d.VectorAngle(zAxis, windowNormal) * 180 / Math.PI; //Window tilt [deg]

          xmlDoc.WriteStartElement("tilt");         //Element tilt - start
          xmlDoc.WriteValue(Math.Round(windowTilt, 3));              //Value tilt
          xmlDoc.WriteEndElement();                 //Element tilt - end
        }

        xmlDoc.WriteStartElement("surfaceEdges");  //Element surfaceEdges - start
        Curve[] Edges = wind.DuplicateNakedEdgeCurves(true, false);
        foreach (var edge in Edges)
        {
          xmlDoc.WriteStartElement("edge");  //Element edge - start
          xmlDoc.WriteStartElement("start");  //Element start - start
          xmlDoc.WriteStartElement("x");          //Element x - start
          xmlDoc.WriteValue(Math.Round(edge.PointAtStart.X, 3));                   //Value x
          xmlDoc.WriteEndElement();               //Element x - end
          xmlDoc.WriteStartElement("y");          //Element y - start
          xmlDoc.WriteValue(Math.Round(edge.PointAtStart.Y, 3));                   //Value y
          xmlDoc.WriteEndElement();               //Element y - end
          xmlDoc.WriteStartElement("z");          //Element z - start
          xmlDoc.WriteValue(Math.Round(edge.PointAtStart.Z, 3));                   //Value z
          xmlDoc.WriteEndElement();               //Element z - end
          xmlDoc.WriteEndElement();               //Element start - end

          xmlDoc.WriteStartElement("end");  //Element end - start
          xmlDoc.WriteStartElement("x");          //Element x - start
          xmlDoc.WriteValue(Math.Round(edge.PointAtEnd.X, 3));                   //Value x
          xmlDoc.WriteEndElement();               //Element x - end
          xmlDoc.WriteStartElement("y");          //Element y - start
          xmlDoc.WriteValue(Math.Round(edge.PointAtEnd.Y, 3));                   //Value y
          xmlDoc.WriteEndElement();               //Element y - end
          xmlDoc.WriteStartElement("z");          //Element z - start
          xmlDoc.WriteValue(Math.Round(edge.PointAtEnd.Z, 3));                   //Value z
          xmlDoc.WriteEndElement();               //Element z - end
          xmlDoc.WriteEndElement();               //Element end - end
          xmlDoc.WriteEndElement();             //Element edge - end
        }

        xmlDoc.WriteEndElement();           //Element surfaceEdges - end
        xmlDoc.WriteEndElement();       //Header window - end

        count++;
      }
    }

    xmlDoc.WriteEndElement();       //Header windows - end

    //----Openable WINDOWS for natural ventilation---- (NOT USED  YET)
    xmlDoc.WriteStartElement("OpenWindows");    //Header windows - start
    windowArea = 0;
    if (OpenableWindows != null)  //Evaluating if a window is given from model
    {
      int count = 0;
      foreach (Brep wind in OpenableWindows) //Possible to have more than one window
      {
        xmlDoc.WriteStartElement("OpenWindow");   //Header window - start

        windowArea = OpenableWindows[count].GetArea(); //Determine area of window

        xmlDoc.WriteStartElement("area");       //Element area - start
        xmlDoc.WriteValue(Math.Round(windowArea, 6));            //Value area
        xmlDoc.WriteEndElement();               //Element area - end

        //Determine window perimeter
        Curve[] windowCurve = Curve.JoinCurves(OpenableWindows[count].GetWireframe(-1));  //Create curve around window
        double windowPerimeter = windowCurve[0].GetLength();   //Get length of curve

        xmlDoc.WriteStartElement("perimeter");  //Element perimeter - start
        xmlDoc.WriteValue(Math.Round(windowPerimeter, 3));       //Value perimeter
        xmlDoc.WriteEndElement();               //Element perimeter - end

        //Determine window corners
        Point3d[] windowCorners = OpenableWindows[count].DuplicateVertices().ToArray();

        //Determine window centers
        windowCenter = VolumeMassProperties.Compute(wind).Centroid;

        xmlDoc.WriteStartElement("cornerCoordinates");  //Element cornerCoordinates - start

        foreach (Point3d c in windowCorners)  //More than one corner
        {
          xmlDoc.WriteStartElement("corners");  //Element corners - start
          xmlDoc.WriteStartElement("x");          //Element x - start
          xmlDoc.WriteValue(c.X);                   //Value x
          xmlDoc.WriteEndElement();               //Element x - end
          xmlDoc.WriteStartElement("y");          //Element y - start
          xmlDoc.WriteValue(c.Y);                   //Value y
          xmlDoc.WriteEndElement();               //Element y - end
          xmlDoc.WriteStartElement("z");          //Element z - start
          xmlDoc.WriteValue(c.Z);                   //Value z
          xmlDoc.WriteEndElement();               //Element z - end
          xmlDoc.WriteEndElement();             //Element corners - end
        }

        xmlDoc.WriteEndElement();           //Element cornerCoordinates - end

        //Determine window orientation
        //Get window normal to face outside
        Vector3d CrossP = Vector3d.CrossProduct((windowCorners[1] - windowCorners[0]), (windowCorners[2] - windowCorners[0]));
        double vectorLength = CrossP.Length;
        windowNormal = CrossP / vectorLength;    //Normalized normal vector of window surface

        double angleSum = new double();   //value used for test

        if (Floor != null)
        {
          int count_F = 0;

          foreach (Brep floor in Floor)     //Loop through floor surfaces
          {
            //Move window corner point with window normal-vector (into or out of the room)
            Point3d[] floorCorners = Floor[count_F].DuplicateVertices().ToArray();    //Getting cornerpoints of floor
            Point3d floorCorner = floorCorners[0];  //Single corner in floor surface
            Point3d windowCorner = windowCorners[0];  //Single corner in window surface
            Point3d windowMove = new Point3d((windowCorner.X + windowNormal.X), (windowCorner.Y + windowNormal.Y), (windowCorner.Z + windowNormal.Z));  //move windowCorner

            //Move window corner to floor height
            Point3d windowToFloor = new Point3d(windowMove.X, windowMove.Y, floorCorner.Z);

            double ang_last = new double();
            double Angle_sum1 = new double();

            //Evaluate if moved point is within the floor surface
            for (int s = 1; s < floorCorners.Length; s++)
            {
              Vector3d v_intPntToPnt1 = new Vector3d(floorCorners[s - 1].X - windowToFloor.X, floorCorners[s - 1].Y - windowToFloor.Y, floorCorners[s - 1].Z - windowToFloor.Z);
              Vector3d v_intPntToPnt2 = new Vector3d(floorCorners[s].X - windowToFloor.X, floorCorners[s].Y - windowToFloor.Y, floorCorners[s].Z - windowToFloor.Z);

              Vector3d v_first = new Vector3d(floorCorners[0].X - windowToFloor.X, floorCorners[0].Y - windowToFloor.Y, floorCorners[0].Z - windowToFloor.Z);
              Vector3d v_last = new Vector3d(floorCorners[floorCorners.Length - 1].X - windowToFloor.X, floorCorners[floorCorners.Length - 1].Y - windowToFloor.Y, floorCorners[floorCorners.Length - 1].Z - windowToFloor.Z);

              ang_last = Vector3d.VectorAngle(v_first, v_last) * 180 / Math.PI;

              Angle_sum1 += Vector3d.VectorAngle(v_intPntToPnt1, v_intPntToPnt2) * 180 / Math.PI;
            }

            angleSum = Math.Round(ang_last + Angle_sum1, 2);

            if (angleSum == 360)
            {
              windowNormal = -windowNormal;

              break;
            }
          }
        }

        if (FloorFacingGround != null && angleSum != 360)
        {
          int count_F = 0;

          foreach (Brep floor in FloorFacingGround)     //Loop through floor surfaces
          {
            //Move window corner point with window normal-vector (into or out of the room)
            Point3d[] floorCorners = FloorFacingGround[count_F].DuplicateVertices().ToArray();    //Getting cornerpoints of floor
            Point3d floorCorner = floorCorners[0];  //Single corner in floor surface
            Point3d windowCorner = windowCorners[0];  //Single corner in window surface
            Point3d windowMove = new Point3d((windowCorner.X + windowNormal.X), (windowCorner.Y + windowNormal.Y), (windowCorner.Z + windowNormal.Z));  //move windowCorner

            //Move window corner to floor height
            Point3d windowToFloor = new Point3d(windowMove.X, windowMove.Y, floorCorner.Z);

            double ang_last = new double();
            double Angle_sum1 = new double();

            //Evaluate if moved point is within the floor surface
            for (int s = 1; s < floorCorners.Length; s++)
            {
              Vector3d v_intPntToPnt1 = new Vector3d(floorCorners[s - 1].X - windowToFloor.X, floorCorners[s - 1].Y - windowToFloor.Y, floorCorners[s - 1].Z - windowToFloor.Z);
              Vector3d v_intPntToPnt2 = new Vector3d(floorCorners[s].X - windowToFloor.X, floorCorners[s].Y - windowToFloor.Y, floorCorners[s].Z - windowToFloor.Z);

              Vector3d v_first = new Vector3d(floorCorners[0].X - windowToFloor.X, floorCorners[0].Y - windowToFloor.Y, floorCorners[0].Z - windowToFloor.Z);
              Vector3d v_last = new Vector3d(floorCorners[floorCorners.Length - 1].X - windowToFloor.X, floorCorners[floorCorners.Length - 1].Y - windowToFloor.Y, floorCorners[floorCorners.Length - 1].Z - windowToFloor.Z);

              ang_last = Vector3d.VectorAngle(v_first, v_last) * 180 / Math.PI;

              Angle_sum1 += Vector3d.VectorAngle(v_intPntToPnt1, v_intPntToPnt2) * 180 / Math.PI;
            }

            angleSum = Math.Round(ang_last + Angle_sum1, 2);

            if (angleSum == 360)
            {
              windowNormal = new Vector3d (-windowNormal.X, -windowNormal.Y, -windowNormal.Z);

              break;
            }
          }
        }

        Vector3d yAxis = new Vector3d(0, -1, 0);   //y-axis
        Vector3d windowNormalXY = new Vector3d(windowNormal.X, windowNormal.Y, 0);  //Window normal in x-y-direction

        double windowOrientation = new double();

        if (windowNormalXY.X <= 0)   //If normal x-coordinate is negative (west)
        {
          windowOrientation = Vector3d.VectorAngle(yAxis, windowNormalXY) * 180 / Math.PI; //Window orientation [deg]
        }
        else                        //normal x-coordinate is positive (east)
        {
          windowOrientation = -Vector3d.VectorAngle(yAxis, windowNormalXY) * 180 / Math.PI;
        }

        xmlDoc.WriteStartElement("orientation");    //Element orientation - start
        xmlDoc.WriteValue(Math.Round(windowOrientation, 3));           //Value orientation
        xmlDoc.WriteEndElement();                   //Element orientation - end

        //Determine window tilt
        Vector3d zAxis = new Vector3d(0, 0, 1);   //z-axis
        double windowTilt = Vector3d.VectorAngle(zAxis, windowNormal) * 180 / Math.PI; //Window tilt [deg]

        xmlDoc.WriteStartElement("tilt");         //Element tilt - start
        xmlDoc.WriteValue(Math.Round(windowTilt, 3));              //Value tilt
        xmlDoc.WriteEndElement();                 //Element tilt - end

        xmlDoc.WriteEndElement();       //Header Openable window - end

        count++;
      }
    }
    xmlDoc.WriteEndElement();       //Header OpenWindows - end

    //----INLET OPENINGS for natural ventilation----
    xmlDoc.WriteStartElement("inlets");    //Header windows - start
    windowArea = 0;
    if (InletOpenings != null)  //Evaluating if a window is given from model
    {
      int count = 0;
      foreach (Brep wind in InletOpenings) //Possible to have more than one window
      {
        xmlDoc.WriteStartElement("inlet");   //Header window - start

        windowArea = InletOpenings[count].GetArea(); //Determine area of window

        xmlDoc.WriteStartElement("area");       //Element area - start
        xmlDoc.WriteValue(Math.Round(windowArea, 6));            //Value area
        xmlDoc.WriteEndElement();               //Element area - end

        //Determine window perimeter
        Curve[] windowCurve = Curve.JoinCurves(InletOpenings[count].GetWireframe(-1));  //Create curve around window
        double windowPerimeter = windowCurve[0].GetLength();   //Get length of curve

        xmlDoc.WriteStartElement("perimeter");  //Element perimeter - start
        xmlDoc.WriteValue(Math.Round(windowPerimeter, 3));       //Value perimeter
        xmlDoc.WriteEndElement();               //Element perimeter - end

        //Determine window corners
        Point3d[] windowCorners = InletOpenings[count].DuplicateVertices().ToArray();

        //Determine window centers
        windowCenter = VolumeMassProperties.Compute(wind).Centroid;

        xmlDoc.WriteStartElement("cornerCoordinates");  //Element cornerCoordinates - start

        foreach (Point3d c in windowCorners)  //More than one corner
        {
          xmlDoc.WriteStartElement("corners");  //Element corners - start
          xmlDoc.WriteStartElement("x");          //Element x - start
          xmlDoc.WriteValue(c.X);                   //Value x
          xmlDoc.WriteEndElement();               //Element x - end
          xmlDoc.WriteStartElement("y");          //Element y - start
          xmlDoc.WriteValue(c.Y);                   //Value y
          xmlDoc.WriteEndElement();               //Element y - end
          xmlDoc.WriteStartElement("z");          //Element z - start
          xmlDoc.WriteValue(c.Z);                   //Value z
          xmlDoc.WriteEndElement();               //Element z - end
          xmlDoc.WriteEndElement();             //Element corners - end
        }

        xmlDoc.WriteEndElement();           //Element cornerCoordinates - end

        //Determine window orientation
        //Get window normal
        Vector3d CrossP = Vector3d.CrossProduct((windowCorners[1] - windowCorners[0]), (windowCorners[2] - windowCorners[0]));
        double vectorLength = CrossP.Length;
        windowNormal = CrossP / vectorLength;    //Normalized normal vector of window surface

        //if window horizontal:
        if (windowNormal.X == 0 & windowNormal.Y == 0)
        {
          double windowOrientation = 0;
          double windowTilt = 0;

          //check if skylight in floor
          Point3d[] FloorCorners;
          if (Floor != null) {FloorCorners = Floor[0].DuplicateVertices().ToArray();}
          else{FloorCorners = FloorFacingGround[0].DuplicateVertices().ToArray();}
          if(windowCorners[0].Z <= FloorCorners[0].Z) //Skylight in floor
          {
            windowTilt = 180;
          }

          xmlDoc.WriteStartElement("orientation");    //Element orientation - start
          xmlDoc.WriteValue(Math.Round(windowOrientation, 3));           //Value orientation
          xmlDoc.WriteEndElement();                   //Element orientation - end

          xmlDoc.WriteStartElement("tilt");         //Element tilt - start
          xmlDoc.WriteValue(Math.Round(windowTilt, 3));              //Value tilt
          xmlDoc.WriteEndElement();                 //Element tilt - end
        }
        else // window not horizontal
        {

          //Get window normal to face outside
          double angleSum = new double();   //value used for test

          if (Floor != null)
          {
            int count_F = 0;

            foreach (Brep floor in Floor)     //Loop through floor surfaces
            {
              //Move window corner point with window normal-vector (into or out of the room)
              Point3d[] floorCorners = Floor[count_F].DuplicateVertices().ToArray();    //Getting cornerpoints of floor
              Point3d floorCorner = floorCorners[0];  //Single corner in floor surface
              Point3d windowCorner = windowCorners[0];  //Single corner in window surface
              Point3d windowMove = new Point3d((windowCorner.X + windowNormal.X), (windowCorner.Y + windowNormal.Y), (windowCorner.Z + windowNormal.Z));  //move windowCorner

              //Move window corner to floor height
              Point3d windowToFloor = new Point3d(windowMove.X, windowMove.Y, floorCorner.Z);

              double ang_last = new double();
              double Angle_sum1 = new double();

              //Evaluate if moved point is within the floor surface
              for (int s = 1; s < floorCorners.Length; s++)
              {
                Vector3d v_intPntToPnt1 = new Vector3d(floorCorners[s - 1].X - windowToFloor.X, floorCorners[s - 1].Y - windowToFloor.Y, floorCorners[s - 1].Z - windowToFloor.Z);
                Vector3d v_intPntToPnt2 = new Vector3d(floorCorners[s].X - windowToFloor.X, floorCorners[s].Y - windowToFloor.Y, floorCorners[s].Z - windowToFloor.Z);

                Vector3d v_first = new Vector3d(floorCorners[0].X - windowToFloor.X, floorCorners[0].Y - windowToFloor.Y, floorCorners[0].Z - windowToFloor.Z);
                Vector3d v_last = new Vector3d(floorCorners[floorCorners.Length - 1].X - windowToFloor.X, floorCorners[floorCorners.Length - 1].Y - windowToFloor.Y, floorCorners[floorCorners.Length - 1].Z - windowToFloor.Z);

                ang_last = Vector3d.VectorAngle(v_first, v_last) * 180 / Math.PI;

                Angle_sum1 += Vector3d.VectorAngle(v_intPntToPnt1, v_intPntToPnt2) * 180 / Math.PI;
              }

              angleSum = Math.Round(ang_last + Angle_sum1, 2);

              if (angleSum == 360)
              {
                windowNormal = -windowNormal;

                break;
              }
            }
          }

          if (FloorFacingGround != null && angleSum != 360)
          {
            int count_F = 0;

            foreach (Brep floor in FloorFacingGround)     //Loop through floor surfaces
            {
              //Move window corner point with window normal-vector (into or out of the room)
              Point3d[] floorCorners = FloorFacingGround[count_F].DuplicateVertices().ToArray();    //Getting cornerpoints of floor
              Point3d floorCorner = floorCorners[0];  //Single corner in floor surface
              Point3d windowCorner = windowCorners[0];  //Single corner in window surface
              Point3d windowMove = new Point3d((windowCorner.X + windowNormal.X), (windowCorner.Y + windowNormal.Y), (windowCorner.Z + windowNormal.Z));  //move windowCorner

              //Move window corner to floor height
              Point3d windowToFloor = new Point3d(windowMove.X, windowMove.Y, floorCorner.Z);

              double ang_last = new double();
              double Angle_sum1 = new double();

              //Evaluate if moved point is within the floor surface
              for (int s = 1; s < floorCorners.Length; s++)
              {
                Vector3d v_intPntToPnt1 = new Vector3d(floorCorners[s - 1].X - windowToFloor.X, floorCorners[s - 1].Y - windowToFloor.Y, floorCorners[s - 1].Z - windowToFloor.Z);
                Vector3d v_intPntToPnt2 = new Vector3d(floorCorners[s].X - windowToFloor.X, floorCorners[s].Y - windowToFloor.Y, floorCorners[s].Z - windowToFloor.Z);

                Vector3d v_first = new Vector3d(floorCorners[0].X - windowToFloor.X, floorCorners[0].Y - windowToFloor.Y, floorCorners[0].Z - windowToFloor.Z);
                Vector3d v_last = new Vector3d(floorCorners[floorCorners.Length - 1].X - windowToFloor.X, floorCorners[floorCorners.Length - 1].Y - windowToFloor.Y, floorCorners[floorCorners.Length - 1].Z - windowToFloor.Z);

                ang_last = Vector3d.VectorAngle(v_first, v_last) * 180 / Math.PI;

                Angle_sum1 += Vector3d.VectorAngle(v_intPntToPnt1, v_intPntToPnt2) * 180 / Math.PI;
              }

              angleSum = Math.Round(ang_last + Angle_sum1, 2);

              if (angleSum == 360)
              {
                windowNormal = new Vector3d (-windowNormal.X, -windowNormal.Y, -windowNormal.Z);

                break;
              }
            }
          }

          Vector3d yAxis = new Vector3d(0, -1, 0);   //y-axis
          Vector3d windowNormalXY = new Vector3d(windowNormal.X, windowNormal.Y, 0);  //Window normal in x-y-direction

          double windowOrientation = new double();

          if (windowNormalXY.X <= 0)   //If normal x-coordinate is negative (west)
          {
            windowOrientation = Vector3d.VectorAngle(yAxis, windowNormalXY) * 180 / Math.PI; //Window orientation [deg]
          }
          else                        //normal x-coordinate is positive (east)
          {
            windowOrientation = -Vector3d.VectorAngle(yAxis, windowNormalXY) * 180 / Math.PI;
          }

          xmlDoc.WriteStartElement("orientation");    //Element orientation - start
          xmlDoc.WriteValue(Math.Round(windowOrientation, 3));           //Value orientation
          xmlDoc.WriteEndElement();                   //Element orientation - end

          //Determine window tilt
          Vector3d zAxis = new Vector3d(0, 0, 1);   //z-axis
          double windowTilt = Vector3d.VectorAngle(zAxis, windowNormal) * 180 / Math.PI; //Window tilt [deg]

          xmlDoc.WriteStartElement("tilt");         //Element tilt - start
          xmlDoc.WriteValue(Math.Round(windowTilt, 3));              //Value tilt
          xmlDoc.WriteEndElement();                 //Element tilt - end
        }
        xmlDoc.WriteEndElement();       //Header Openable window - end

        count++;
      }
    }
    xmlDoc.WriteEndElement();       //Header inlets - end

    //----OUTLET OPENINGS for natural ventilation----
    xmlDoc.WriteStartElement("outlets");    //Header windows - start
    windowArea = 0;
    if (OutletOpenings != null)  //Evaluating if a window is given from model
    {
      int count = 0;
      foreach (Brep wind in OutletOpenings) //Possible to have more than one window
      {
        xmlDoc.WriteStartElement("outlet");   //Header window - start

        windowArea = OutletOpenings[count].GetArea(); //Determine area of window

        xmlDoc.WriteStartElement("area");       //Element area - start
        xmlDoc.WriteValue(Math.Round(windowArea, 6));            //Value area
        xmlDoc.WriteEndElement();               //Element area - end

        //Determine window perimeter
        Curve[] windowCurve = Curve.JoinCurves(OutletOpenings[count].GetWireframe(-1));  //Create curve around window
        double windowPerimeter = windowCurve[0].GetLength();   //Get length of curve

        xmlDoc.WriteStartElement("perimeter");  //Element perimeter - start
        xmlDoc.WriteValue(Math.Round(windowPerimeter, 3));       //Value perimeter
        xmlDoc.WriteEndElement();               //Element perimeter - end

        //Determine window corners
        Point3d[] windowCorners = OutletOpenings[count].DuplicateVertices().ToArray();

        //Determine window centers
        windowCenter = VolumeMassProperties.Compute(wind).Centroid;

        xmlDoc.WriteStartElement("cornerCoordinates");  //Element cornerCoordinates - start

        foreach (Point3d c in windowCorners)  //More than one corner
        {
          xmlDoc.WriteStartElement("corners");  //Element corners - start
          xmlDoc.WriteStartElement("x");          //Element x - start
          xmlDoc.WriteValue(c.X);                   //Value x
          xmlDoc.WriteEndElement();               //Element x - end
          xmlDoc.WriteStartElement("y");          //Element y - start
          xmlDoc.WriteValue(c.Y);                   //Value y
          xmlDoc.WriteEndElement();               //Element y - end
          xmlDoc.WriteStartElement("z");          //Element z - start
          xmlDoc.WriteValue(c.Z);                   //Value z
          xmlDoc.WriteEndElement();               //Element z - end
          xmlDoc.WriteEndElement();             //Element corners - end
        }

        xmlDoc.WriteEndElement();           //Element cornerCoordinates - end

        //Determine window orientation
        //Get window normal
        Vector3d CrossP = Vector3d.CrossProduct((windowCorners[1] - windowCorners[0]), (windowCorners[2] - windowCorners[0]));
        double vectorLength = CrossP.Length;
        windowNormal = CrossP / vectorLength;    //Normalized normal vector of window surface

        //if window horizontal:
        if (windowNormal.X == 0 & windowNormal.Y == 0)
        {
          double windowOrientation = 0;
          double windowTilt = 0;

          //check if skylight in floor
          Point3d[] FloorCorners;
          if (Floor != null) {FloorCorners = Floor[0].DuplicateVertices().ToArray();}
          else{FloorCorners = FloorFacingGround[0].DuplicateVertices().ToArray();}
          if(windowCorners[0].Z <= FloorCorners[0].Z) //Skylight in floor
          {
            windowTilt = 180;
          }

          xmlDoc.WriteStartElement("orientation");    //Element orientation - start
          xmlDoc.WriteValue(Math.Round(windowOrientation, 3));           //Value orientation
          xmlDoc.WriteEndElement();                   //Element orientation - end

          xmlDoc.WriteStartElement("tilt");         //Element tilt - start
          xmlDoc.WriteValue(Math.Round(windowTilt, 3));              //Value tilt
          xmlDoc.WriteEndElement();                 //Element tilt - end
        }
        else // window not horizontal
        {

          //Get window normal to face outside
          double angleSum = new double();   //value used for test

          if (Floor != null)
          {
            int count_F = 0;

            foreach (Brep floor in Floor)     //Loop through floor surfaces
            {
              //Move window corner point with window normal-vector (into or out of the room)
              Point3d[] floorCorners = Floor[count_F].DuplicateVertices().ToArray();    //Getting cornerpoints of floor
              Point3d floorCorner = floorCorners[0];  //Single corner in floor surface
              Point3d windowCorner = windowCorners[0];  //Single corner in window surface
              Point3d windowMove = new Point3d((windowCorner.X + windowNormal.X), (windowCorner.Y + windowNormal.Y), (windowCorner.Z + windowNormal.Z));  //move windowCorner

              //Move window corner to floor height
              Point3d windowToFloor = new Point3d(windowMove.X, windowMove.Y, floorCorner.Z);

              double ang_last = new double();
              double Angle_sum1 = new double();

              //Evaluate if moved point is within the floor surface
              for (int s = 1; s < floorCorners.Length; s++)
              {
                Vector3d v_intPntToPnt1 = new Vector3d(floorCorners[s - 1].X - windowToFloor.X, floorCorners[s - 1].Y - windowToFloor.Y, floorCorners[s - 1].Z - windowToFloor.Z);
                Vector3d v_intPntToPnt2 = new Vector3d(floorCorners[s].X - windowToFloor.X, floorCorners[s].Y - windowToFloor.Y, floorCorners[s].Z - windowToFloor.Z);

                Vector3d v_first = new Vector3d(floorCorners[0].X - windowToFloor.X, floorCorners[0].Y - windowToFloor.Y, floorCorners[0].Z - windowToFloor.Z);
                Vector3d v_last = new Vector3d(floorCorners[floorCorners.Length - 1].X - windowToFloor.X, floorCorners[floorCorners.Length - 1].Y - windowToFloor.Y, floorCorners[floorCorners.Length - 1].Z - windowToFloor.Z);

                ang_last = Vector3d.VectorAngle(v_first, v_last) * 180 / Math.PI;

                Angle_sum1 += Vector3d.VectorAngle(v_intPntToPnt1, v_intPntToPnt2) * 180 / Math.PI;
              }

              angleSum = Math.Round(ang_last + Angle_sum1, 2);

              if (angleSum == 360)
              {
                windowNormal = -windowNormal;

                break;
              }
            }
          }

          if (FloorFacingGround != null && angleSum != 360)
          {
            int count_F = 0;

            foreach (Brep floor in FloorFacingGround)     //Loop through floor surfaces
            {
              //Move window corner point with window normal-vector (into or out of the room)
              Point3d[] floorCorners = FloorFacingGround[count_F].DuplicateVertices().ToArray();    //Getting cornerpoints of floor
              Point3d floorCorner = floorCorners[0];  //Single corner in floor surface
              Point3d windowCorner = windowCorners[0];  //Single corner in window surface
              Point3d windowMove = new Point3d((windowCorner.X + windowNormal.X), (windowCorner.Y + windowNormal.Y), (windowCorner.Z + windowNormal.Z));  //move windowCorner

              //Move window corner to floor height
              Point3d windowToFloor = new Point3d(windowMove.X, windowMove.Y, floorCorner.Z);

              double ang_last = new double();
              double Angle_sum1 = new double();

              //Evaluate if moved point is within the floor surface
              for (int s = 1; s < floorCorners.Length; s++)
              {
                Vector3d v_intPntToPnt1 = new Vector3d(floorCorners[s - 1].X - windowToFloor.X, floorCorners[s - 1].Y - windowToFloor.Y, floorCorners[s - 1].Z - windowToFloor.Z);
                Vector3d v_intPntToPnt2 = new Vector3d(floorCorners[s].X - windowToFloor.X, floorCorners[s].Y - windowToFloor.Y, floorCorners[s].Z - windowToFloor.Z);

                Vector3d v_first = new Vector3d(floorCorners[0].X - windowToFloor.X, floorCorners[0].Y - windowToFloor.Y, floorCorners[0].Z - windowToFloor.Z);
                Vector3d v_last = new Vector3d(floorCorners[floorCorners.Length - 1].X - windowToFloor.X, floorCorners[floorCorners.Length - 1].Y - windowToFloor.Y, floorCorners[floorCorners.Length - 1].Z - windowToFloor.Z);

                ang_last = Vector3d.VectorAngle(v_first, v_last) * 180 / Math.PI;

                Angle_sum1 += Vector3d.VectorAngle(v_intPntToPnt1, v_intPntToPnt2) * 180 / Math.PI;
              }

              angleSum = Math.Round(ang_last + Angle_sum1, 2);

              if (angleSum == 360)
              {
                windowNormal = new Vector3d (-windowNormal.X, -windowNormal.Y, -windowNormal.Z);

                break;
              }
            }
          }

          Vector3d yAxis = new Vector3d(0, -1, 0);   //y-axis
          Vector3d windowNormalXY = new Vector3d(windowNormal.X, windowNormal.Y, 0);  //Window normal in x-y-direction

          double windowOrientation = new double();

          if (windowNormalXY.X <= 0)   //If normal x-coordinate is negative (west)
          {
            windowOrientation = Vector3d.VectorAngle(yAxis, windowNormalXY) * 180 / Math.PI; //Window orientation [deg]
          }
          else                        //normal x-coordinate is positive (east)
          {
            windowOrientation = -Vector3d.VectorAngle(yAxis, windowNormalXY) * 180 / Math.PI;
          }



          xmlDoc.WriteStartElement("orientation");    //Element orientation - start
          xmlDoc.WriteValue(Math.Round(windowOrientation, 3));           //Value orientation
          xmlDoc.WriteEndElement();                   //Element orientation - end

          //Determine window tilt
          Vector3d zAxis = new Vector3d(0, 0, 1);   //z-axis
          double windowTilt = Vector3d.VectorAngle(zAxis, windowNormal) * 180 / Math.PI; //Window tilt [deg]

          xmlDoc.WriteStartElement("tilt");         //Element tilt - start
          xmlDoc.WriteValue(Math.Round(windowTilt, 3));              //Value tilt
          xmlDoc.WriteEndElement();                 //Element tilt - end
        }
        xmlDoc.WriteEndElement();       //Header Openable window - end

        count++;
      }
    }

    xmlDoc.WriteEndElement();       //Header outlets - end

    //----EXTERNAL Geometry----

    xmlDoc.WriteStartElement("shadingSurfaces");  //Header shadingSurfaces - start

    if (ExternalGeometry != null)
    {
      foreach (Brep shade in ExternalGeometry)   //Possible to have more than one shading surface
      {
        Point3d[] shadingCorners = shade.DuplicateVertices();   //Get shadingsurface corners from model

        xmlDoc.WriteStartElement("shading");    //Header shading - start
        xmlDoc.WriteStartElement("cornerCoordinates");  //Element cornercoordinates - start

        foreach (Point3d s in shadingCorners)   //More than one coordinate
        {
          xmlDoc.WriteStartElement("corners");  //Element corners - start
          xmlDoc.WriteStartElement("x");          //Element x - start
          xmlDoc.WriteValue(Math.Round(s.X, 3));                   //Value x
          xmlDoc.WriteEndElement();               //Element x - end
          xmlDoc.WriteStartElement("y");          //Element y - start
          xmlDoc.WriteValue(Math.Round(s.Y, 3));                   //Value y
          xmlDoc.WriteEndElement();               //Element y - end
          xmlDoc.WriteStartElement("z");          //Element z - start
          xmlDoc.WriteValue(Math.Round(s.Z, 3));                   //Value z
          xmlDoc.WriteEndElement();               //Element z - end
          xmlDoc.WriteEndElement();             //Element corners - end
        }

        xmlDoc.WriteEndElement();             //Element cornercoordinates - end
        xmlDoc.WriteEndElement();           //Header shading - end
      }
    }

    xmlDoc.WriteEndElement();           //Header shadingSurfaces - end

    //----All Internal Walls----
    xmlDoc.WriteStartElement("internalWalls");    //Header windows - start
    List<Brep> AllWalls = new List<Brep>();
    if (IntWalls != null){foreach ( var s in IntWalls){AllWalls.Add(s);}}
    if (ExtWalls != null){foreach ( var s in ExtWalls){AllWalls.Add(s);}}


    if (AllWalls != null)  //Evaluating if a wall is given from model
    {
      int count = 0;
      foreach (Brep surf in AllWalls) //Possible to have more than one wall
      {
        xmlDoc.WriteStartElement("wall");   //Header wall - start

        //Determine surf corners
        Point3d[] c = surf.DuplicateVertices().ToArray();

        //Determine surf centers
        //Point3d SurfCenter = VolumeMassProperties.Compute(surf).Centroid;

        xmlDoc.WriteStartElement("surfaceEdges");  //Element surfaceEdges - start
        Curve[] Edges = surf.DuplicateNakedEdgeCurves(true, false);
        foreach (var edge in Edges)
        {
          xmlDoc.WriteStartElement("edge");  //Element edge - start
          xmlDoc.WriteStartElement("start");  //Element start - start
          xmlDoc.WriteStartElement("x");          //Element x - start
          xmlDoc.WriteValue(Math.Round(edge.PointAtStart.X, 3));                   //Value x
          xmlDoc.WriteEndElement();               //Element x - end
          xmlDoc.WriteStartElement("y");          //Element y - start
          xmlDoc.WriteValue(Math.Round(edge.PointAtStart.Y, 3));                   //Value y
          xmlDoc.WriteEndElement();               //Element y - end
          xmlDoc.WriteStartElement("z");          //Element z - start
          xmlDoc.WriteValue(Math.Round(edge.PointAtStart.Z, 3));                   //Value z
          xmlDoc.WriteEndElement();               //Element z - end
          xmlDoc.WriteEndElement();               //Element start - end

          xmlDoc.WriteStartElement("end");  //Element end - start
          xmlDoc.WriteStartElement("x");          //Element x - start
          xmlDoc.WriteValue(Math.Round(edge.PointAtEnd.X, 3));                   //Value x
          xmlDoc.WriteEndElement();               //Element x - end
          xmlDoc.WriteStartElement("y");          //Element y - start
          xmlDoc.WriteValue(Math.Round(edge.PointAtEnd.Y, 3));                   //Value y
          xmlDoc.WriteEndElement();               //Element y - end
          xmlDoc.WriteStartElement("z");          //Element z - start
          xmlDoc.WriteValue(Math.Round(edge.PointAtEnd.Z, 3));                   //Value z
          xmlDoc.WriteEndElement();               //Element z - end
          xmlDoc.WriteEndElement();               //Element end - end
          xmlDoc.WriteEndElement();             //Element edge - end
        }


        xmlDoc.WriteEndElement();           //Element surfaceEdges - end

        //Get  normal
        Vector3d CrossP = Vector3d.CrossProduct((c[1] - c[0]), (c[2] - c[0]));
        double vectorLength = CrossP.Length;
        Vector3d surfNormal = CrossP / vectorLength;    //Normalized normal vector of surface

        //if surf horizontal (ceiling):
        if (surfNormal.X == 0 & surfNormal.Y == 0)
        {
          xmlDoc.WriteStartElement("normal");    //Element normal - start
          xmlDoc.WriteStartElement("x");          //Element x - start
          xmlDoc.WriteValue(Math.Round(surfNormal.X, 3));                   //Value x
          xmlDoc.WriteEndElement();               //Element x - end
          xmlDoc.WriteStartElement("y");          //Element y - start
          xmlDoc.WriteValue(Math.Round(surfNormal.Y, 3));                   //Value y
          xmlDoc.WriteEndElement();               //Element y - end
          xmlDoc.WriteStartElement("z");          //Element z - start
          xmlDoc.WriteValue(Math.Round(Convert.ToDouble(-1), 3));                   //Value z
          xmlDoc.WriteEndElement();               //Element z - end
          xmlDoc.WriteEndElement();                   //Element normal - end

        }
        else // surf not horizontal
        {

          //Get surf normal to face inside
          double angleSum = new double();   //value used for test

          List<Brep> AllFloors = new List<Brep>();
          if (Floor != null){foreach ( var s in Floor){AllFloors.Add(s);}}
          if (FloorFacingGround != null){foreach ( var s in FloorFacingGround){AllFloors.Add(s);}}

          if (AllFloors != null)
          {
            int count_F = 0;

            foreach (Brep floor in AllFloors)     //Loop through floor surfaces
            {
              //Move window corner point with window normal-vector (into or out of the room)
              Point3d[] floorCorners = Floor[count_F].DuplicateVertices().ToArray();    //Getting cornerpoints of floor
              Point3d floorCorner = floorCorners[0];  //Single corner in floor surface
              Point3d surfCorner = c[0];  //Single corner in window surface
              Point3d surfMove = new Point3d((surfCorner.X + surfNormal.X), (surfCorner.Y + surfNormal.Y), (surfCorner.Z + surfNormal.Z));  //move windowCorner

              //Move window corner to floor height
              Point3d surfToFloor = new Point3d(surfMove.X, surfMove.Y, floorCorner.Z);

              double ang_last = new double();
              double Angle_sum1 = new double();

              //Evaluate if moved point is within the floor surface
              for (int s = 1; s < floorCorners.Length; s++)
              {
                Vector3d v_intPntToPnt1 = new Vector3d(floorCorners[s - 1].X - surfToFloor.X, floorCorners[s - 1].Y - surfToFloor.Y, floorCorners[s - 1].Z - surfToFloor.Z);
                Vector3d v_intPntToPnt2 = new Vector3d(floorCorners[s].X - surfToFloor.X, floorCorners[s].Y - surfToFloor.Y, floorCorners[s].Z - surfToFloor.Z);

                Vector3d v_first = new Vector3d(floorCorners[0].X - surfToFloor.X, floorCorners[0].Y - surfToFloor.Y, floorCorners[0].Z - surfToFloor.Z);
                Vector3d v_last = new Vector3d(floorCorners[floorCorners.Length - 1].X - surfToFloor.X, floorCorners[floorCorners.Length - 1].Y - surfToFloor.Y, floorCorners[floorCorners.Length - 1].Z - surfToFloor.Z);

                ang_last = Vector3d.VectorAngle(v_first, v_last) * 180 / Math.PI;

                Angle_sum1 += Vector3d.VectorAngle(v_intPntToPnt1, v_intPntToPnt2) * 180 / Math.PI;
              }

              angleSum = Math.Round(ang_last + Angle_sum1, 2);

              if (angleSum != 360)
              {
                surfNormal = -surfNormal;

                break;
              }
            }
          }

          xmlDoc.WriteStartElement("normal");    //Element normal - start
          xmlDoc.WriteStartElement("x");          //Element x - start
          xmlDoc.WriteValue(Math.Round(surfNormal.X, 3));                   //Value x
          xmlDoc.WriteEndElement();               //Element x - end
          xmlDoc.WriteStartElement("y");          //Element y - start
          xmlDoc.WriteValue(Math.Round(surfNormal.Y, 3));                   //Value y
          xmlDoc.WriteEndElement();               //Element y - end
          xmlDoc.WriteStartElement("z");          //Element z - start
          xmlDoc.WriteValue(Math.Round(surfNormal.Z, 3));                   //Value z
          xmlDoc.WriteEndElement();               //Element z - end
          xmlDoc.WriteEndElement();                   //Element normal - end

        }
        xmlDoc.WriteEndElement();       //Header wall - end

        count++;
      }
    }

    xmlDoc.WriteEndElement();       //Header internalWalls - end

    //----All Ceilings----
    xmlDoc.WriteStartElement("internalCeilings");    //Header internalCeilings - start
    List<Brep> AllCeilings = new List<Brep>();
    if (Ceiling != null) {foreach ( var s in Ceiling){AllCeilings.Add(s);}}
    if (Roof != null) {foreach ( var s in Roof){AllCeilings.Add(s);}}

    if (AllCeilings != null)  //Evaluating if a wall is given from model
    {
      int count = 0;
      foreach (Brep surf in AllCeilings) //Possible to have more than one wall
      {
        xmlDoc.WriteStartElement("ceiling");   //Header ceiling - start

        //Determine surf corners
        Point3d[] c = surf.DuplicateVertices().ToArray();

        //Determine surf centers
        //SurfCenter = VolumeMassProperties.Compute(wind).Centroid;

        xmlDoc.WriteStartElement("surfaceEdges");  //Element surfaceEdges - start
        Curve[] Edges = surf.DuplicateNakedEdgeCurves(true, false);
        foreach (var edge in Edges)
        {
          xmlDoc.WriteStartElement("edge");  //Element edge - start
          xmlDoc.WriteStartElement("start");  //Element start - start
          xmlDoc.WriteStartElement("x");          //Element x - start
          xmlDoc.WriteValue(Math.Round(edge.PointAtStart.X, 3));                   //Value x
          xmlDoc.WriteEndElement();               //Element x - end
          xmlDoc.WriteStartElement("y");          //Element y - start
          xmlDoc.WriteValue(Math.Round(edge.PointAtStart.Y, 3));                   //Value y
          xmlDoc.WriteEndElement();               //Element y - end
          xmlDoc.WriteStartElement("z");          //Element z - start
          xmlDoc.WriteValue(Math.Round(edge.PointAtStart.Z, 3));                   //Value z
          xmlDoc.WriteEndElement();               //Element z - end
          xmlDoc.WriteEndElement();               //Element start - end

          xmlDoc.WriteStartElement("end");  //Element end - start
          xmlDoc.WriteStartElement("x");          //Element x - start
          xmlDoc.WriteValue(Math.Round(edge.PointAtEnd.X, 3));                   //Value x
          xmlDoc.WriteEndElement();               //Element x - end
          xmlDoc.WriteStartElement("y");          //Element y - start
          xmlDoc.WriteValue(Math.Round(edge.PointAtEnd.Y, 3));                   //Value y
          xmlDoc.WriteEndElement();               //Element y - end
          xmlDoc.WriteStartElement("z");          //Element z - start
          xmlDoc.WriteValue(Math.Round(edge.PointAtEnd.Z, 3));                   //Value z
          xmlDoc.WriteEndElement();               //Element z - end
          xmlDoc.WriteEndElement();               //Element end - end
          xmlDoc.WriteEndElement();             //Element edge - end
        }


        xmlDoc.WriteEndElement();           //Element surfaceEdges - end

        //Get  normal
        Vector3d CrossP = Vector3d.CrossProduct((c[1] - c[0]), (c[2] - c[0]));
        double vectorLength = CrossP.Length;
        Vector3d surfNormal = CrossP / vectorLength;    //Normalized normal vector of surface

        //if ceiling normal upward:
        if (surfNormal.Z > 0)
        {
          surfNormal = -surfNormal;

        }

        xmlDoc.WriteStartElement("normal");    //Element normal - start
        xmlDoc.WriteStartElement("x");          //Element x - start
        xmlDoc.WriteValue(Math.Round(surfNormal.X, 3));                   //Value x
        xmlDoc.WriteEndElement();               //Element x - end
        xmlDoc.WriteStartElement("y");          //Element y - start
        xmlDoc.WriteValue(Math.Round(surfNormal.Y, 3));                   //Value y
        xmlDoc.WriteEndElement();               //Element y - end
        xmlDoc.WriteStartElement("z");          //Element z - start
        xmlDoc.WriteValue(Math.Round(surfNormal.Z, 3));                   //Value z
        xmlDoc.WriteEndElement();               //Element z - end
        xmlDoc.WriteEndElement();                   //Element normal - end


        xmlDoc.WriteEndElement();       //Header celing - end

        count++;
      }
    }

    xmlDoc.WriteEndElement();       //Header internalCeilings - end

    //----All Floors----
    xmlDoc.WriteStartElement("internalFloors");    //Header internalCeilings - start
    List<Brep> AllFloor = new List<Brep>();
    if (Floor != null){foreach ( var s in Floor){AllFloor.Add(s);}}
    if (FloorFacingGround != null){foreach ( var s in FloorFacingGround){AllFloor.Add(s);}}

    if (AllFloor != null)  //Evaluating if a wall is given from model
    {
      int count = 0;
      foreach (Brep surf in AllFloor) //Possible to have more than one wall
      {
        xmlDoc.WriteStartElement("floor");   //Header ceiling - start

        //Determine surf corners
        Point3d[] c = surf.DuplicateVertices().ToArray();

        //Determine surf centers
        // SurfCenter = VolumeMassProperties.Compute(wind).Centroid;

        xmlDoc.WriteStartElement("surfaceEdges");  //Element surfaceEdges - start
        Curve[] Edges = surf.DuplicateNakedEdgeCurves(true, false);
        foreach (var edge in Edges)
        {
          xmlDoc.WriteStartElement("edge");  //Element edge - start
          xmlDoc.WriteStartElement("start");  //Element start - start
          xmlDoc.WriteStartElement("x");          //Element x - start
          xmlDoc.WriteValue(Math.Round(edge.PointAtStart.X, 3));                   //Value x
          xmlDoc.WriteEndElement();               //Element x - end
          xmlDoc.WriteStartElement("y");          //Element y - start
          xmlDoc.WriteValue(Math.Round(edge.PointAtStart.Y, 3));                   //Value y
          xmlDoc.WriteEndElement();               //Element y - end
          xmlDoc.WriteStartElement("z");          //Element z - start
          xmlDoc.WriteValue(Math.Round(edge.PointAtStart.Z, 3));                   //Value z
          xmlDoc.WriteEndElement();               //Element z - end
          xmlDoc.WriteEndElement();               //Element start - end

          xmlDoc.WriteStartElement("end");  //Element end - start
          xmlDoc.WriteStartElement("x");          //Element x - start
          xmlDoc.WriteValue(Math.Round(edge.PointAtEnd.X, 3));                   //Value x
          xmlDoc.WriteEndElement();               //Element x - end
          xmlDoc.WriteStartElement("y");          //Element y - start
          xmlDoc.WriteValue(Math.Round(edge.PointAtEnd.Y, 3));                   //Value y
          xmlDoc.WriteEndElement();               //Element y - end
          xmlDoc.WriteStartElement("z");          //Element z - start
          xmlDoc.WriteValue(Math.Round(edge.PointAtEnd.Z, 3));                   //Value z
          xmlDoc.WriteEndElement();               //Element z - end
          xmlDoc.WriteEndElement();               //Element end - end
          xmlDoc.WriteEndElement();             //Element edge - end
        }

        xmlDoc.WriteEndElement();           //Element surfaceEdges - end

        //Get  normal
        Vector3d CrossP = Vector3d.CrossProduct((c[1] - c[0]), (c[2] - c[0]));
        double vectorLength = CrossP.Length;
        Vector3d surfNormal = CrossP / vectorLength;    //Normalized normal vector of surface

        //if ceiling normal upward:
        if (surfNormal.Z < 0)
        {
          surfNormal = -surfNormal;

        }

        xmlDoc.WriteStartElement("normal");    //Element normal - start
        xmlDoc.WriteStartElement("x");          //Element x - start
        xmlDoc.WriteValue(Math.Round(surfNormal.X, 3));                   //Value x
        xmlDoc.WriteEndElement();               //Element x - end
        xmlDoc.WriteStartElement("y");          //Element y - start
        xmlDoc.WriteValue(Math.Round(surfNormal.Y, 3));                   //Value y
        xmlDoc.WriteEndElement();               //Element y - end
        xmlDoc.WriteStartElement("z");          //Element z - start
        xmlDoc.WriteValue(Math.Round(surfNormal.Z, 3));                   //Value z
        xmlDoc.WriteEndElement();               //Element z - end
        xmlDoc.WriteEndElement();                   //Element normal - end


        xmlDoc.WriteEndElement();       //Header floor - end

        count++;
      }

    }
     xmlDoc.WriteEndElement();       //Header internalfloors - end

    //----All DaylightGrids----
    xmlDoc.WriteStartElement("internalGrids");    //Header internalCeilings - start
    List<Brep> AllGrids = new List<Brep>();
    if (DaylightGrids != null){foreach ( var s in DaylightGrids){AllGrids.Add(s);}}

    if (AllGrids != null)  //Evaluating if a wall is given from model
    {
      int count = 0;
      foreach (Brep surf in AllGrids) //Possible to have more than one wall
      {
        xmlDoc.WriteStartElement("grid");   //Header ceiling - start

        //Determine surf corners
        Point3d[] c = surf.DuplicateVertices().ToArray();

        //Determine surf centers
        // SurfCenter = VolumeMassProperties.Compute(wind).Centroid;

        xmlDoc.WriteStartElement("surfaceEdges");  //Element surfaceEdges - start
        Curve[] Edges = surf.DuplicateNakedEdgeCurves(true, false);
        foreach (var edge in Edges)
        {
          xmlDoc.WriteStartElement("edge");  //Element edge - start
          xmlDoc.WriteStartElement("start");  //Element start - start
          xmlDoc.WriteStartElement("x");          //Element x - start
          xmlDoc.WriteValue(Math.Round(edge.PointAtStart.X, 3));                   //Value x
          xmlDoc.WriteEndElement();               //Element x - end
          xmlDoc.WriteStartElement("y");          //Element y - start
          xmlDoc.WriteValue(Math.Round(edge.PointAtStart.Y, 3));                   //Value y
          xmlDoc.WriteEndElement();               //Element y - end
          xmlDoc.WriteStartElement("z");          //Element z - start
          xmlDoc.WriteValue(Math.Round(edge.PointAtStart.Z, 3));                   //Value z
          xmlDoc.WriteEndElement();               //Element z - end
          xmlDoc.WriteEndElement();               //Element start - end

          xmlDoc.WriteStartElement("end");  //Element end - start
          xmlDoc.WriteStartElement("x");          //Element x - start
          xmlDoc.WriteValue(Math.Round(edge.PointAtEnd.X, 3));                   //Value x
          xmlDoc.WriteEndElement();               //Element x - end
          xmlDoc.WriteStartElement("y");          //Element y - start
          xmlDoc.WriteValue(Math.Round(edge.PointAtEnd.Y, 3));                   //Value y
          xmlDoc.WriteEndElement();               //Element y - end
          xmlDoc.WriteStartElement("z");          //Element z - start
          xmlDoc.WriteValue(Math.Round(edge.PointAtEnd.Z, 3));                   //Value z
          xmlDoc.WriteEndElement();               //Element z - end
          xmlDoc.WriteEndElement();               //Element end - end
          xmlDoc.WriteEndElement();             //Element edge - end
        }

        xmlDoc.WriteEndElement();           //Element surfaceEdges - end

        //Get  normal
        Vector3d CrossP = Vector3d.CrossProduct((c[1] - c[0]), (c[2] - c[0]));
        double vectorLength = CrossP.Length;
        Vector3d surfNormal = CrossP / vectorLength;    //Normalized normal vector of surface

        //if ceiling normal upward:
        if (surfNormal.Z < 0)
        {
          surfNormal = -surfNormal;

        }

        xmlDoc.WriteStartElement("normal");    //Element normal - start
        xmlDoc.WriteStartElement("x");          //Element x - start
        xmlDoc.WriteValue(Math.Round(surfNormal.X, 3));                   //Value x
        xmlDoc.WriteEndElement();               //Element x - end
        xmlDoc.WriteStartElement("y");          //Element y - start
        xmlDoc.WriteValue(Math.Round(surfNormal.Y, 3));                   //Value y
        xmlDoc.WriteEndElement();               //Element y - end
        xmlDoc.WriteStartElement("z");          //Element z - start
        xmlDoc.WriteValue(Math.Round(surfNormal.Z, 3));                   //Value z
        xmlDoc.WriteEndElement();               //Element z - end
        xmlDoc.WriteEndElement();                   //Element normal - end


        xmlDoc.WriteEndElement();       //Header floor - end

        count++;
      }

    }


    xmlDoc.WriteEndElement();       //Header internalGrids - end


    xmlDoc.WriteEndDocument();  //End document (Header Room - end)

    xmlDoc.Flush();

    xmlDoc.Close();

    //string codeDone = "Code is done";

    //CenterOfWindows = windowCenter;
    //NormalVectorOfWindow = windowNormal;

    //Write_CSV(@"C:\ICEbear\Grasshopper\GH_14\Roaming\DaylightLuxLevel.csv", DaylightLuxLevel);

    if(OpenICEbearGUI == true)
    {
      //-----------------------------------------------------------
      // open ICEbearGUI.exe and run simulation:
      //--------------------------------------------------------      
    string programFiles = System.Environment.GetFolderPath(System.Environment.SpecialFolder.ProgramFiles);
    string exePath = System.IO.Path.Combine(programFiles, "ICEbear", "ICEbearGUI_2.00.exe");
    System.Diagnostics.Process p = new System.Diagnostics.Process();
    p.StartInfo.FileName = exePath;
    p.Start();
      //p.WaitForExit();
    }
    }
}
# ---------- end icebear_gui_ver_2_2_0_0 ----------
